# Grasshopper definition assembly_ex4_solar.ghx (Grasshopper 1.0.7)

panel = Panel("Reload libraries")
bang = Button()
unload = PythonScript(bang=bang)
# ---------- unload: Python ----------
from compas_rhino.utilities.misc import get_tolerance
from compas_rhino.utilities.misc import unload_modules

unload_modules("compas")
unload_modules("compas_fab")
unload_modules("ur_online_control")
unload_modules("climate_active_bricks")
unload_modules("assembly_information_model")
# ---------- end unload ----------

py = PythonScript()  # -> HERE, DATA
# ---------- py: Python ----------
import os

HERE = os.path.dirname(ghdoc.Path)
DATA = os.path.abspath(os.path.join(HERE, "..", "data"))
print(HERE)
print(DATA)
# ---------- end py ----------

# ----
# Alternative: from JSON
# load assembly from json file
panel_2 = Panel("brickwall_interfaces_ex2.json")
assembly = PythonScript(DATA=py.DATA, filename=panel_2)  # -> assembly
# ---------- assembly: Python ----------
import os
import sys
sys.path.append(os.path.abspath(os.path.join(DATA, "..")))

from assembly_information_model.assembly import Assembly

filepath = os.path.join(DATA, filename)

assembly = Assembly.from_json(filepath)
# ---------- end assembly ----------

# ----
# Ex4
show = BooleanToggle(True)
draw = PythonScript(assembly=assembly, show_all=show)  # -> G, gripping_planes_WCS
# ---------- draw: Python ----------
import os
import sys

import math

from compas_ghpython.artists import MeshArtist
from compas_ghpython import draw_frame

G = []

key_index = assembly.network.key_index()
keys = [key_index[key] for key in assembly.network.nodes()]
elements = [assembly.element(key) for key in keys]

gripping_planes_WCS = [draw_frame(e.gripping_frame) for e in elements]

if show_all:
    for element in elements:
        artist = MeshArtist(element.mesh)
        mesh = artist.draw_mesh()
        G.append(mesh)
# ---------- end draw ----------
geo = Geometry(draw.G)
pln = Plane(draw.gripping_planes_WCS)
preview = CustomPreview(Geometry=geo, Shader=ColourSwatch(SwatchColor=RGB(255, 255, 255)))
preview_2 = CustomPreview(Geometry=pln, Shader=ColourSwatch(SwatchColor=RGB(178, 178, 178)))
